# Grasshopper definition C#ScriptingForGrasshopperSamples_WS_003.gh (Grasshopper 1.0.7)
# Copyright: bernhard muller bijoutiers
# plug-ins: Workshop, Bifocals, Pufferfish

# Essential Guide to C# Scripting
# inspired by: Rajaa Issa
wickerson_s_first_grasshopper_component = WickersonsFirstGrasshopperComponent()  # disabled
# The Grasshopper C# Component
gene_pool = GenePool(
    Decimals=0,
    Maximum=100,
    Minimum=0,
    Value=[26.00110165, 58.48794848, 18.50926313, 22.38775521, 50.92372608, 5.508037985, 64.50332332, 87.46321243, 32.0196855, 36.53144456])  # disabled
# The Grasshopper C# Component
# 
# List Access
number_slider = Slider(0, range=0..10)

# ----
# The Grasshopper C# Component
# 
# Item Access
number_slider_2 = Slider(10, range=0..10)
series = Series(Start=Slider(100, range=0..100), Step=Slider(10, range=0..10), Count=number_slider_2)
jitter = Jitter(List=series, Jitter=Slider(1, range=0..1), Seed=Slider(12, range=0..100))  # -> Values, Indices
panel = Panel(series)
c_script = CSharpScript(x=series, y=jitter.Values)  # -> out, A, B; inputs x: Double, y: Double
# ---------- c_script: C# ----------
    A = 0.10 * (x + y);
    B = x / y;
    Print("Rajaa Issa's got iteration " + Iteration + " figured out!");
# ---------- end c_script ----------
panel_2 = Panel(jitter.Values)
panel_3 = Panel(c_script.out)
panel_4 = Panel(c_script.A)
panel_5 = Panel(c_script.B)
construct_domain = ConstructDomain(DomainStart=Slider(2, range=0..2), DomainEnd=Slider(5, range=0..5))
list_length = ListLength(List=c_script.A)
unit_x = UnitX(Factor=c_script.A)
range = Range(Domain=construct_domain, Steps=expr("x-1", list_length))
gene_pool_2 = GenePool(
    Decimals=0,
    Maximum=10,
    Minimum=0,
    Value=[9.423100888, 8.036045399, 0.5896379848, 1.092948397, 4.504869061, 3.043187765, 2.959585834, 9.833903359, 0.7324921064, 1.092993706])
sphere = Sphere(Base=PlaneXY(0, 0, 0), Radius=range)
panel_6 = Panel("-1")
move = Move(Geometry=sphere, Motion=unit_x)  # -> Geometry, Transform
list_item = ListItem(List=c_script.B, Index=gene_pool_2, Wrap=True)
list_length_2 = ListLength(List=move.Geometry)
range_2 = Range(Domain=list_item, Steps=expr("x-1", list_length_2))
pi = Pi(Factor=range_2)  # -> simplify(Output)
rotate_3d = Rotate3D(Geometry=move.Geometry, Angle=pi, Center=Point(0, 0, 0), Axis=Vector(0, 0, 1))  # -> flatten(Geometry), Transform
volume = Volume(Geometry=rotate_3d.Geometry)  # -> Volume, Centroid
graph_mapper = GraphMapper(
    c_script.B,
    x0=0,
    x1=1,
    y0=0,
    y1=1,
    Ox=0.4657400846,
    Oy=0.4071531296,
    Px=0.728559196,
    Py=0.4514133334,
    container_name="Parabola")
remap = Remap(data=c_script.B, min=Slider(0, range=0..0.01), max=Slider(1, range=0..1))
interpolate = Interpolate(Vertices=volume.Centroid, Degree=3, Periodic=False, KnotStyle=1)  # -> Curve, Length, Domain
nurbs_curve = NurbsCurve(Degree=3, Periodic=False)  # -> Curve, Length, Domain
pipe_variable = PipeVariable(Curve=reparameterize(interpolate.Curve), Parameters=remap, Radii=graph_mapper, Caps="2")
merge = Merge(Data1=rotate_3d.Geometry, Data2=pipe_variable)
explode_tree = ExplodeTree(Data=merge)  # -> Branch0, _0000
geometry = Geometry(explode_tree.Branch0)
geometry_2 = Geometry(explode_tree._0000)
param_viewer = ParamViewer(explode_tree.Branch0)
panel_7 = Panel(explode_tree.Branch0)
panel_8 = Panel(explode_tree._0000)

series_2 = Series(Start=number_slider, Step=Slider(2, range=0..10), Count=Slider(10, range=0..10))
iseven_isodd_c_script = CSharpScript(num=gene_pool)  # -> out, IsEven, IsOdd; inputs num: Int32; disabled
# ---------- iseven_isodd_c_script: C# ----------
    int mod1 = num % 2;
    IsEven = (mod1 == 0 ? true : false);

    int mod2 = num % 2;
    IsOdd = (mod2 == 1 ? true : false);
# ---------- end iseven_isodd_c_script ----------
panel_9 = Panel(gene_pool)  # disabled
shift_list = ShiftList(List=series_2, Shift=Slider(2, range=0..10), Wrap=True)
panel_10 = Panel(iseven_isodd_c_script.IsOdd)  # disabled
panel_11 = Panel(iseven_isodd_c_script.IsEven)  # disabled
integer = Integer(iseven_isodd_c_script.IsOdd)  # disabled
integer_2 = Integer(iseven_isodd_c_script.IsEven)  # disabled
c_script_2 = CSharpScript(xList=series_2, yList=shift_list, z=Slider(10, range=0..10))  # -> out, A, B; inputs xList: list of Double, yList: list of Double, z: Int32
# ---------- c_script_2: C# ----------
    List<double> newList1 = new List<double>();
    foreach( var x in xList)
      newList1.Add(x + 10);
    Print("List Access runs only once, # of iterations = " + Iteration);
    A = newList1;
    
    List<double> newList2 = new List<double>();
    foreach( var x in yList)
      newList2.Add(x + 2 * z);
    Print("List Access runs only once, # of iterations = " + Iteration);
    B = newList2;
# ---------- end c_script_2 ----------
panel_12 = Panel(integer)  # disabled
panel_13 = Panel(integer_2)  # disabled
panel_14 = Panel(c_script_2.A)
panel_15 = Panel(c_script_2.out)
sphere_2 = Sphere(Base=PlaneXY(0, 0, 0), Radius=1)  # disabled
panel_16 = Panel(c_script_2.B)
unit_x_2 = UnitX(Factor=integer_2)  # disabled
unit_z = UnitZ(Factor=integer)  # disabled
quad_sphere = QuadSphere(Base=PlaneXY(0, 0, 0), Radius=1)
number_slider_3 = Slider(2, range=0..2)  # disabled
move_2 = Move(Geometry=sphere_2, Motion=unit_x_2)  # -> Geometry, Transform; disabled
move_3 = Move(Geometry=sphere_2, Motion=unit_z)  # -> Geometry, Transform; disabled
deconstruct_brep = DeconstructBrep(Brep=quad_sphere)  # -> Faces, Edges, Vertices
list_length_3 = ListLength(List=move_2.Geometry)  # disabled
number_slider_4 = Slider(1, range=0..1)  # disabled
list_length_4 = ListLength(List=move_3.Geometry)  # disabled
range_3 = Range(Domain=number_slider_3, Steps=expr("x-1", list_length_3))  # disabled
split_list = SplitList(List=deconstruct_brep.Faces, Index=Slider(2, range=0..6))  # -> ListA, ListB
range_4 = Range(Domain=number_slider_3, Steps=expr("x-1", list_length_4))  # disabled
list_indices = ListIndices(List=split_list.ListA)
vector_xyz = VectorXYZ(XComponent=0, YComponent=0, ZComponent=number_slider_4)  # -> Vector, Length; disabled
vector_xyz_2 = VectorXYZ(XComponent=number_slider_4, YComponent=0, ZComponent=0)  # -> Vector, Length; disabled
pi_2 = Pi(Factor=range_3)  # disabled
pi_3 = Pi(Factor=range_4)  # disabled
list_item_2 = ListItem(List=deconstruct_brep.Faces, Index=list_indices, Wrap=True)
rotate_3d_2 = Rotate3D(Geometry=move_2.Geometry, Angle=pi_2, Center=Point(0, 0, 0), Axis=vector_xyz.Vector)  # -> Geometry, Transform; disabled
rotate_3d_3 = Rotate3D(Geometry=move_3.Geometry, Angle=pi_3, Center=Point(0, 0, 0), Axis=vector_xyz_2.Vector)  # -> Geometry, Transform; disabled
merge_2 = Merge(Data1=rotate_3d_2.Geometry, Data2=rotate_3d_3.Geometry)  # disabled
solid_union = SolidUnion(Breps=merge_2)  # disabled

# ==== cluster Remap: Remaps numbers
data = ClusterInput()
min = ClusterInput()
max = ClusterInput()
bnd = Bounds(Numbers=data)
dom = ConstructDomain(DomainStart=min, DomainEnd=max)
remap = RemapNumbers(Value=data, Source=bnd, Target=dom)  # -> Mapped, Clipped
R = ClusterOutput(remap.Mapped)
